# Grasshopper definition unnamed.gh (Grasshopper 1.0.7)
# plug-ins: Weaverbird, Human UI

# ----
# UserInterface elements
number_slider = Slider(300, range=0..1000)
wbicosahedron = WeaverbirdsMeshMeshIcosahedron(Plane=PlaneXY(0, 0, 0), Radius=5)
_3dview = Create3DView(MeshToDisplay=wbicosahedron, MeshColors=RGB(255, 0, 0), ViewWidth=number_slider, ViewHeight=Slider(300, range=0..1000))
button = CreateButton(ButtonName="Upload stl file", ButtonStyle=0)
button_2 = CreateButton(ButtonName="Add holes", ButtonStyle=0)

# ----
# the main window
toggle = BooleanToggle(False)
launchwin = LaunchWindow(
    Show=toggle,
    Name="Uist 2024",
    Width=Slider(400, range=0..1000),
    Height=Slider(500, range=0..1000),
    FontFamily="Arial",
    ChildStatus=0,
    EnableHorizScroll=False)

merge = Merge(Data1=_3dview, Data2=button, Data3=button_2)
addelems = AddElements(Window=launchwin, Elements=flatten(merge), DoVLChecking=True)  # -> AddedElements, ElementNames
