# Grasshopper definition GHDemo.gh (Grasshopper 1.0.7)
# plug-ins: Human UI, PMDeditor

textsize = Slider(13, range=0..1000)
height = Slider(35, range=0..1000)
width = Slider(350, range=0..1000)

# ---- group: Cell Generation
width_2 = Slider(230, range=0..1000)
height_2 = Slider(35, range=0..1000)
button = CreateButton(ButtonName="Cell Generation", ButtonStyle=0)
adjustpos = AdjustElementPositioning(
    ElementsToAdjust=button,
    Margin="20,5,0,10",
    AbsolutePositioning=False,
    Width=width_2,
    Height=height_2,
    HorizontalAlignment=Slider(0, range=0..100))
titlesize = Slider(13, range=0..30)
adjustelem = AdjustElementAppearance(ElementsToAdjust=button, FontSize=titlesize)

# ----
radiobtn = CreateRadioButton(RadioButtonName="Circle", RadioButtonGroup="Group shape", InitiallySelected=False)
radiobtn_2 = CreateRadioButton(RadioButtonName="Regular Hexagon", RadioButtonGroup="Group shape", InitiallySelected=False)
radiobtn_3 = CreateRadioButton(RadioButtonName="Square", RadioButtonGroup="Group shape", InitiallySelected=False)

# ---- group: Body Selection
width_3 = Slider(230, range=0..1000)
height_3 = Slider(35, range=0..1000)
button_2 = CreateButton(ButtonName="Model Selection", ButtonStyle=0)
adjustpos_2 = AdjustElementPositioning(
    ElementsToAdjust=button_2,
    Margin="20,5,0,0",
    AbsolutePositioning=False,
    Width=width_3,
    Height=height_3,
    HorizontalAlignment=Slider(0, range=0..100))
titlesize_2 = Slider(13, range=0..30)
adjustelem_2 = AdjustElementAppearance(ElementsToAdjust=button_2, FontSize=titlesize_2)

# ---- group: Pattern Selection
panel = Panel("""...
Circle
Square
Regular hexagon""")
pulldown = CreatePulldownMenu(Label="Cell type:", ListItems=panel, showLabel=True)
width_4 = Slider(230, range=0..1000)
height_4 = Slider(35, range=0..1000)
titlesize_3 = Slider(13, range=0..30)
adjustpos_3 = AdjustElementPositioning(
    ElementsToAdjust=pulldown,
    Margin="15,5,0,0",
    AbsolutePositioning=False,
    Width=width_4,
    Height=height_4,
    HorizontalAlignment=Slider(0, range=0..100))
adjustelem_3 = AdjustElementAppearance(ElementsToAdjust=pulldown, FontSize=titlesize_3)

# ----
label = CreateLabel(LabelText="----------------Cell Type------------------", LabelSize=textsize, Justification=0)
width_5 = Slider(230, range=0..1000)
height_5 = Slider(35, range=0..1000)
adjustpos_4 = AdjustElementPositioning(
    ElementsToAdjust=label,
    Margin="15,5,5,0",
    AbsolutePositioning=False,
    Width=width,
    Height=height,
    HorizontalAlignment=Slider(0, range=0..100))
width_6 = Slider(230, range=0..1000)
width_7 = Slider(230, range=0..1000)
height_6 = Slider(35, range=0..1000)
height_7 = Slider(35, range=0..1000)
adjustpos_5 = AdjustElementPositioning(
    ElementsToAdjust=radiobtn,
    Margin="10,-10,0,0",
    AbsolutePositioning=False,
    Width=width_5,
    Height=height_5,
    HorizontalAlignment=Slider(0, range=0..100))
adjustpos_6 = AdjustElementPositioning(
    ElementsToAdjust=radiobtn_2,
    Margin="143,-35,0,0",
    AbsolutePositioning=False,
    Width=width_7,
    Height=height_7,
    HorizontalAlignment=Slider(0, range=0..100))
adjustpos_7 = AdjustElementPositioning(
    ElementsToAdjust=radiobtn_3,
    Margin="72,-35,0,0",
    AbsolutePositioning=False,
    Width=width_6,
    Height=height_6,
    HorizontalAlignment=Slider(0, range=0..100))
values = ValueListener(Elements=button, SomeProperty=True)  # -> Values, Indices
values_2 = ValueListener(Elements=radiobtn, SomeProperty=True)  # -> Values, Indices
values_3 = ValueListener(Elements=radiobtn_3, SomeProperty=True)  # -> Values, Indices
values_4 = ValueListener(Elements=radiobtn_2, SomeProperty=True)  # -> Values, Indices
panel_2 = Panel(values_2.Values)
panel_3 = Panel(values_3.Values)
panel_4 = Panel(values_4.Values)
values_5 = ValueListener(Elements=button_2, SomeProperty=True)  # -> Values, Indices
possel = PosSelect(BodySeleActivated=values_5.Values)  # -> SelectedBodyBrep, SelectedBodyMesh
cg = CellGeneration(SelectedBodyBrep=possel.SelectedBodyBrep, CellGenActivated=values.Values, SelectedBodyMesh=possel.SelectedBodyMesh)
typesel = CellTypeSelect(CircleSelect=values_2.Values, HexagonSelect=values_3.Values, HexagonSelect_2=values_4.Values)
panel_5 = Panel(cg)
panel_6 = Panel(typesel)
panel_7 = Panel(possel.SelectedBodyBrep)
panel_8 = Panel(possel.SelectedBodyMesh)

# ---- group: MAIN WINDOW
merge = Merge(Data1=button_2, Data2=label, Data3=radiobtn, Data4=radiobtn_3, Data5=radiobtn_2, Data17=button)
launchwin = LaunchWindow(
    Show=Toggle(True),
    Name="Magneophoretic Display Tool",
    Width=Slider(290, range=0..1000),
    Height=Slider(220, range=0..1000),
    ChildStatus=0,
    EnableHorizScroll=False)
addelems = AddElements(Window=launchwin, Elements=flatten(merge), DoVLChecking=True)  # -> AddedElements, ElementNames
